% Simulink data dictionary ConfigData.sldd

SoundSpeed = 300
CanaryAmplitude = 1
CanaryCarrierFrequency = 20000
CanaryDataRate = 100
PreConvolveDownsample = 32
WalshCodeIndex = [3 9]
SampleRate = 48000
FmFrequencyDifferential = 400
FmDecoderFrameSize = 128
WalshCodeLength = 16
DataAmplitude = 1

UnModulatedCanaryCachedCycle = [-0.144842 -0.1318727
 0.01339702 -0.01790285
 0.121534 0.1571084
 -0.2306883 -0.2378336
 0.2903972 0.2336828
 -0.2871576 -0.1472122
 0.2225341 0.0100285
 -0.1121581 0.1294941
 -0.01628856 -0.2218853
 0.1310908 0.2351298
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 ]

WalshCodeCache = [-1 -1
 1 1
 1 1
 1 1
 1 1
 1 1
 1 1
 1 1
 1 1
 1 1
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 ]

ModulatedCanaryCachedCycle = [-0.144842 -0.1318727
 0.01339702 -0.01790285
 0.121534 0.1571084
 -0.2306883 -0.2378336
 0.2903972 0.2336828
 -0.2871576 -0.1472122
 0.2225341 0.0100285
 -0.1121581 0.1294941
 -0.01628856 -0.2218853
 0.1310908 0.2351298
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 ]